# Grasshopper definition cubeVolume.gh (Grasshopper 1.0.7)

edgelength = GetInteger(Slider(10, range=0..10), AtLeast=1, AtMost=2147483647, Maximum=2147483647, Minimum=-2147483648)

# ---- group: RH_IN:EdgeLength
int = Integer(edgelength)

# ----
dom = ConstructDomain(DomainStart=0, DomainEnd=int)
rectangle = Rectangle(Plane=PlaneXY(0, 0, 0), XSize=dom, YSize=dom, Radius=0)  # -> Rectangle, Length
boxrec = BoxRectangle(Rectangle=rectangle.Rectangle, Height=int)
volume = Volume(Geometry=boxrec)  # -> Volume, Centroid

# ---- group: RH_OUT:Volume
txt = Text(volume.Volume)
